% Simulink data dictionary ConfigData.sldd

SoundSpeed = 300
CanaryAmplitude = 1
CanaryCarrierFrequency = 20000
CanaryDataRate = 100
PreConvolveDownsample = 32
WalshCodeIndex = [3 9]
SampleRate = 48000
FmFrequencyDifferential = 400
DataAmplitude = 10
FmDecoderFrameSize = 128
WalshCodeLength = 16

WalshCodeCache = [-1 -1
 1 1
 1 1
 1 1
 1 1
 1 1
 1 1
 1 1
 1 1
 1 1
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 ]

ModulatedCanaryCachedCycle = [0.7614232 0.7614232
 -0.386053 -0.386053
 -0.07347188 -0.07347188
 0.5169808 0.5169808
 -0.8477943 -0.8477943
 0.9937984 0.9937984
 -0.9231652 -0.9231652
 0.6512914 0.6512914
 -0.2374433 -0.2374433
 -0.2281616 -0.2281616
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 ]